test file "WorkshopTests"

suite "BumplessPID"

  case "Bumpless_Test" [baseline]
    model BumplessPID_UuT, harness BumplessPID_UuT_Harness1 (for BumplessPID_UuT/Bumpless_PID)

  case "ParameterSweep_Test" [baseline]
    model BumplessPID_UuT, harness BumplessPID_UuT_Harness2 (for BumplessPID_UuT/Bumpless_PID)
    baseline "ParamSweepBaselineOut.mat"
      Out:1: rel tol 100
      Error:1: abs tol 5
    iterations:
      Iteration1: SignalBuilderGroup "Ki01"
      Iteration2: SignalBuilderGroup "Ki1"
      Iteration3: SignalBuilderGroup "Ki10"
      Iteration4: SignalBuilderGroup "Ki2"